# Grasshopper definition robot_control.gh (Grasshopper 1.0.7)
# plug-ins: VirtualRobot.Grasshopper, Hops

# ---- group: Calibration Parameters
save = Button()
filename = Text("Targets\targets_test.json")

# ---- group: Robot System
pt = Point("132.7, -28.7, 138.3")
yz = YZPlane(Origin=pt)
pflip = FlipPlane(Plane=yz, ReverseX=False, ReverseY=False, SwapAxes=Toggle(True))
xy = XYPlane(Origin=Point(0, 0, 0))
prot = RotatePlane(Plane=pflip, Angle="pi/2")
mesh = Mesh([<mesh referenced from the Rhino model> x125])
define_end_effector = DefineEndEffector(Geometry=mesh, TCPFrame=prot, MountingFrame=xy)
xy_plane = XYPlane(Origin=Point(0, 0, 0))
predefined_kuka_kr_210_robot = PredefinedKUKAKR210Robot(RobRootFrame=xy_plane, EndEffectorOptional=define_end_effector, variant="R2700")

# ---- group: Calibration
origin = Point(Point(2807.19, -1250.03, 41.94))
xdir = Point(Point(3014.23, -1501.96, 803.2))
ydir = Point(Point(2213.62, -1759.37, 38.84))

# ---- group: Calibration Parameters
distance_domain = Panel("1000 to 1500")
angle_domain_deg = Panel("0 to 45")
num_batches = Number("2")
range = Range(Domain=distance_domain, Steps=expr("x-1", num_batches))
num_shots = Number("3")
range_2 = Range(Domain=angle_domain_deg, Steps=expr("x-1", num_shots))
distances = Number(range)
angles = Number(range_2)

# ---- group: Canvas
width = Panel("1000")
height = Panel("1000")
construct_domain = ConstructDomain(DomainStart=0, DomainEnd=width)
construct_domain_2 = ConstructDomain(DomainStart=0, DomainEnd=height)
rectangle = Rectangle(Plane=PlaneXY(0, 0, 0), XSize=construct_domain, YSize=construct_domain_2, Radius=0)  # -> Rectangle, Length
canvas = Rectangle(rectangle.Rectangle)

# ---- group: Generate Targets
canvas_2 = Rectangle(canvas)
force = Slider(281, range=1..1000)
curve = Curve(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)
point_count = Slider(60, range=1..100)
populate_2d = Populate2D(Region=canvas_2, Count=point_count, Seed=1)
curve_closest_point = CurveClosestPoint(Point=populate_2d, Curve=curve)  # -> Point, Parameter, Distance
vector_2pt = Vector2Pt(PointA=populate_2d, PointB=curve_closest_point.Point, Unitize=Toggle(True))  # -> Vector, Length
bounds = Bounds(Numbers=curve_closest_point.Distance)
remap_numbers = RemapNumbers(Value=curve_closest_point.Distance, Source=bounds, Target=Domain(0, 1))  # -> Mapped, Clipped
graph_mapper = GraphMapper(
    remap_numbers.Mapped,
    x0=0,
    x1=1,
    y0=0,
    y1=1,
    container_name="Bezier",
    cpx=[0, 0.3294326961, 0.1552128345, 1],
    cpy=[0, 1, 1, 1])
multiplication = Multiplication(A=force, B=graph_mapper)
amplitude = Amplitude(Vector=vector_2pt.Vector, Amplitude=multiplication)
move = Move(Geometry=populate_2d, Motion=amplitude)  # -> Geometry, Transform
point = Point(move.Geometry)

# ---- group: Calibration
plane_fit = PlaneFit(Points=[origin, xdir, ydir])  # -> Plane, Deviation
vector_2pt_2 = Vector2Pt(PointA=origin, PointB=xdir, Unitize=False)  # -> Vector, Length
plane_origin = PlaneOrigin(Base=plane_fit.Plane, Origin=origin)
align_plane = AlignPlane(Plane=plane_origin, Direction=vector_2pt_2.Vector)  # -> Plane, Angle
flip_plane = FlipPlane(Plane=align_plane.Plane, ReverseX=False, ReverseY=True, SwapAxes=True)
workpiece = Plane(flip_plane)
rectangle_2 = Rectangle(Plane=workpiece, XSize="1000", YSize="2000", Radius=0)  # -> Rectangle, Length
target_surface = Curve(rectangle_2.Rectangle)
target = Rectangle(target_surface)

# ----
gframe = GetFrame(Frame=prot, ReferenceFrame=xy)  # -> XYZLocation, ABCOrientation
panel = Panel([gframe.XYZLocation, gframe.ABCOrientation])
target_2 = Rectangle(target)
number_slider = Slider(1000, range=0..2000)
explode = Explode(Curve=target_2, Recursive=True)  # -> Segments, Vertices
item = ListItem(List=explode.Segments, Index=0, Wrap=True)  # -> Item, Item1, Item2
end = EndPoints(Curve=item.Item1)  # -> Start, End
vec2pt = Vector2Pt(PointA=end.End, PointB=end.Start, Unitize=False)  # -> Vector, Length
Z = UnitZ(Factor=number_slider)
amp = Amplitude(Vector=vec2pt.Vector, Amplitude=number_slider)
move_2 = Move(Geometry=item.Item2, Motion=amp)  # -> Geometry, Transform
midpt = CurveMiddle(Curve=move_2.Geometry)

# ---- group: Reorient Targets
xy_plane_2 = XYPlane(Origin=Point(0, 0, 0))
orient = Orient(Geometry=canvas, Source=xy_plane_2, Target=workpiece)  # -> Geometry, Transform
orient_2 = Orient(Geometry=point, Source=xy_plane_2, Target=workpiece)  # -> Geometry, Transform
point_2 = Point(orient_2.Geometry)

# ----
scale = Scale(Geometry=move_2.Geometry, Center=midpt, Factor=0.5)  # -> Geometry, Transform
num_batches_2 = Number(expr("x-1", num_batches))
target_3 = Rectangle(target)
divide = DivideCurve(Curve=scale.Geometry, Count=num_batches_2, Kinks=False)  # -> Points, Tangents, Parameters
boundary = BoundarySurfaces(Edges=target_3)
srf_cp = SurfaceClosestPoint(Point=divide.Points, Surface=boundary)  # -> Point, UVPoint, Distance
distances_2 = Number(distances)
evalsrf = EvaluateSurface(Surface=boundary, Point=srf_cp.UVPoint)  # -> Point, Normal, UDirection, VDirection, Frame
point_3 = Point(Point(2328.37, -1346.63, 727.19))
plane = Plane(workpiece)
target_point = Point(evalsrf.Point)
amp_2 = Amplitude(Vector=evalsrf.Normal, Amplitude=distances_2)
move_3 = Move(Geometry=target_point, Motion=amp_2)  # -> Geometry, Transform

# ---- group: Preview
rectangle_3 = Rectangle(orient.Geometry)
point_4 = Point(point_2)
mesh_plane = MeshPlane(Boundary=rectangle_3, WidthCount=10, HeightCount=10)  # -> Mesh, Area
custom_preview = CustomPreview(Geometry=mesh_plane.Mesh, Material=ColourSwatch(SwatchColor=RGB(54, 54, 54)))
dot_display = DotDisplay(Point=point_4, Colour=ColourSwatch(SwatchColor=RGBA(255, 255, 255, 146)), Size=50)

# ----
vector_2pt_3 = Vector2Pt(PointA=point_2, PointB=point_3, Unitize=False)  # -> Vector, Length
plane_origin_2 = PlaneOrigin(Base=plane, Origin=point_3)
ln = Line(StartPoint=move_3.Geometry, EndPoint=target_point)
flip_plane_2 = FlipPlane(Plane=plane_origin_2, ReverseX=True, ReverseY=True, SwapAxes=False)
pframe = PerpFrame(Curve=ln, Parameter="0")
prot_2 = RotatePlane(Plane=pframe, Angle="0")
adjust_plane = AdjustPlane(Plane=flip_plane_2, Normal=vector_2pt_3.Vector)
deconstruct_plane = DeconstructPlane(Plane=flip_plane_2)  # -> Origin, XAxis, YAxis, ZAxis
pflip_2 = FlipPlane(Plane=prot_2, ReverseX=False, ReverseY=False, SwapAxes=True)
pln = Plane(graft(pflip_2))
align_plane_2 = AlignPlane(Plane=adjust_plane, Direction=deconstruct_plane.XAxis)  # -> Plane, Angle
deplane = DeconstructPlane(Plane=pln)  # -> Origin, XAxis, YAxis, ZAxis
list_item = ListItem(List=align_plane_2.Plane, Index=Slider(14, range=0..19), Wrap=True)
len = Number(vector_2pt_3.Length)
get_frame = GetFrame(Frame=list_item)  # -> XYZLocation, ABCOrientation
pl = PlaneNormal(Origin=deplane.Origin, ZAxis=deplane.YAxis)
angles_2 = Number(angles)
target_point_2 = Point(target_point)
rootdir = GhPythonScript()  # -> rootdir
# ---------- rootdir: Python ----------
rootdir = ghdoc.Path.rsplit("\\", 1)[0] + "\\"
# ---------- end rootdir ----------
target_loc = Point(plane)
pos_loc = Point(point_3)
rotate = Rotate(Geometry=pln, Angle=expr("x", degrees(angles_2)), Plane=pl)  # -> Geometry, Transform
ln_2 = Line(StartPoint=rotate.Geometry, EndPoint=graft(target_point_2))
concat = Concatenate(FragmentA=rootdir, FragmentB="Models\")
pdecon = Deconstruct(Point=pos_loc)  # -> XComponent, YComponent, ZComponent
pdecon_2 = Deconstruct(Point=target_loc)  # -> XComponent, YComponent, ZComponent
pframe_2 = PerpFrame(Curve=ln_2, Parameter="1")
hops = Hops(
    Pos_x=pdecon.XComponent,
    Pos_y=pdecon.YComponent,
    Pos_z=pdecon.ZComponent,
    Target_x=pdecon_2.XComponent,
    Target_y=pdecon_2.YComponent,
    Target_z=pdecon_2.ZComponent,
    FilePath=concat,
    CacheResultsInMemory=True,
    CacheSolveResults=True,
    RemoteDefinitionLocation="http://127.0.0.1:5000/Calibration",
    RemoteSolveVersion=(0, 1, 0),
    ShowInput_Enabled=False,
    ShowInput_Path=False,
    SynchronousSolve=True)
rootdir_2 = GhPythonScript()  # -> rootdir; same code as rootdir
filename_2 = Text(filename)
pflip_3 = FlipPlane(Plane=pframe_2, ReverseX=False, ReverseY=False, SwapAxes=Toggle(True))
pln_2 = Plane(flatten(rotate.Geometry))
merge = Merge(Data1=Toggle(False), Data2=Toggle(False), Data3=Toggle(False))
panel_2 = Panel(hops)
concat_2 = Concatenate(FragmentA=rootdir_2, FragmentB=filename_2)
save_2 = Boolean(save)
gframe_2 = GetFrame(Frame=simplify(flatten(rotate.Geometry)))  # -> XYZLocation, ABCOrientation
gframe_3 = GetFrame(Frame=simplify(flatten(pflip_3)))  # -> XYZLocation, ABCOrientation
robot_ik = RobotInverseKinematics(Robot=predefined_kuka_kr_210_robot, TargetTCPFrame=pln_2, AxisToggles=merge, useColorPreview=True)  # -> PoseGeometry, AxisValues, AxisFrames
robot_inverse_kinematics = RobotInverseKinematics(Robot=predefined_kuka_kr_210_robot, TargetTCPFrame=list_item, AxisToggles=[False, False, False], useColorPreview=True)  # -> PoseGeometry, AxisValues, AxisFrames
mesh_2 = Mesh(robot_ik.PoseGeometry)
savetarget = GhPythonScript(
    pos_loc=gframe_2.XYZLocation,
    pos_ang=gframe_2.ABCOrientation,
    target_loc=gframe_3.XYZLocation,
    target_ang=gframe_3.ABCOrientation,
    filepath=concat_2,
    save=save_2)  # inputs pos_loc: list of Point3d, pos_ang: list of Point3d, target_loc: list of Point3d, target_ang: list of Point3d, save: Boolean
# ---------- savetarget: Python ----------
import json
import Rhino as rh

if save:

    json_dict = {"Targets":[]}
    
    for pl,pa,tl,ta in zip(pos_loc, pos_ang, target_loc, target_ang):
        
        json_dict["Targets"].append({
            "pos_x" : pl.X,
            "pos_y" : pl.Y,
            "pos_z" : pl.Z,
            "pos_a" : pa.X,
            "pos_b" : pa.Y,
            "pos_c" : pa.Z,
            "target_x" : tl.X,
            "target_y" : tl.Y,
            "target_z" : tl.Z,
            "target_a" : ta.X,
            "target_b" : ta.Y,
            "target_c" : ta.Z,
            "target_dist" : pl.DistanceTo(tl)
            })
    
    with open(filepath, 'w') as file:
        file.write(json.dumps(json_dict, sort_keys=True, indent = 4))
# ---------- end savetarget ----------
custom_preview_2 = CustomPreview(Geometry=robot_inverse_kinematics.PoseGeometry, Material=ColourSwatch(SwatchColor=RGBA(92, 92, 92, 160)))
